# Grasshopper definition data-generator.gh (Grasshopper 1.0.8)

vector_xyz = VectorXYZ(XComponent=0, YComponent=0, ZComponent=0)  # -> Vector, Length
point = Point(vector_xyz.Vector)
number_slider = Slider(300, range=0..1000)
rectangle = Rectangle(Plane=point, XSize=number_slider, YSize=number_slider, Radius=0)  # -> Rectangle, Length
populate_2d = Populate2D(Region=rectangle.Rectangle, Count=100, Seed=1)
construct_domain = ConstructDomain(DomainStart=Slider(5, range=0..100), DomainEnd=Slider(100, range=0..100))
voronoi = Voronoi(Points=populate_2d, Boundary=rectangle.Rectangle, BruteForceOverride=False)
list_length = ListLength(List=voronoi)
multiplication = Multiplication(A=list_length, B=Slider(0.7, range=0..1))
random_reduce = RandomReduce(List=voronoi, Reduction=multiplication, Seed=Slider(481, range=0..1000))
list_length_2 = ListLength(List=random_reduce)
random = Random(Range=construct_domain, Number=list_length_2, Seed=2)
unit_z = UnitZ(Factor=random)
move = Move(Geometry=random_reduce, Motion=unit_z)  # -> Geometry, Transform
extrude = Extrude(Base=random_reduce, Direction=unit_z)
boundary_surfaces = BoundarySurfaces(Edges=rectangle.Rectangle)
cap_holes = CapHoles(Brep=extrude)
mesh_brep = MeshBrep(
    Brep=[boundary_surfaces, cap_holes],
    Settings={GridMaxCount=0, GridMinCount=16, JaggedSeams=False, MaxEdgeLength=0, MinEdgeLength=0.0001, MinTolerance=0, Refine=True, RefineAngle=0, RelativeTolerance=0.65, SimplePlanes=True, Tolerance=0})  # -> flatten(Mesh)
mesh_join = MeshJoin(Meshes=mesh_brep)
mesh = Mesh(mesh_join)
deconstruct_mesh = DeconstructMesh(Mesh=mesh)  # -> Vertices, Faces, Colours, Normals
deconstruct = Deconstruct(Point=deconstruct_mesh.Vertices)  # -> XComponent, YComponent, ZComponent
bounds = Bounds(Numbers=deconstruct.ZComponent)
deconstruct_domain = DeconstructDomain(Domain=bounds)  # -> Start, End
gradient = Gradient(
    LowerLimit=deconstruct_domain.Start,
    UpperLimit=deconstruct_domain.End,
    Parameter=deconstruct.ZComponent,
    stops=[0: RGB(0, 0, 0), 1: RGB(255, 255, 255)])
mesh_colours = MeshColours(Mesh=mesh, Colours=gradient)
